# Grasshopper definition 01_ros_load_and_visualization.ghx (Grasshopper 1.0.7)

# ----
# Goal 02
box = Box([{Plane=PlaneXY(-0.15, -0.15, -0.15), X=Domain(0, 0.3), Y=Domain(0, 0.3), Z=Domain(0, 0.3)}, {Plane=Plane(origin=(0.2008, 0.15, -0.15), x=(1, 0, 0), y=(0, -1, 0)), X=Domain(0, 0.3), Y=Domain(0, 0.3), Z=Domain(-0.3, 0)}, {Plane=Plane(origin=(0.5516, 0.15, -0.15), x=(1, 0, 0), y=(0, -1, 0)), X=Domain(0, 0.3), Y=Domain(0, 0.3), Z=Domain(-0.3, 0)}, {Plane=PlaneXY(-0.15, 0.2008, -0.1500000001), X=Domain(0, 0.3), Y=Domain(0, 0.3), Z=Domain(0, 0.3)}, {Plane=PlaneXY(0.5516, 0.2008, -0.1500000001), X=Domain(0, 0.3), Y=Domain(0, 0.3), Z=Domain(0, 0.3)}, {Plane=PlaneXY(-0.15, 0.5516, -0.1500000003), X=Domain(0, 0.3), Y=Domain(0, 0.3), Z=Domain(0, 0.3)}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])
panel = Panel("Goal02")

# ----
# QUICK FIX FOR TESTING
cluster = Cluster(geometry=box)

number_slider = Slider(4, range=0..8)  # disabled

panel_2 = Panel("Goal04")  # disabled
# Goal 04
box_2 = Box([{Plane=Plane(origin=(-0.15, 0.15, -0.15), x=(1, 0, 0), y=(0, -1, 0)), X=Domain(0, 0.3), Y=Domain(0, 0.3), Z=Domain(-0.3, 0)}, {Plane=PlaneXY(0.2008, -0.15, -0.1500000003), X=Domain(0, 0.3), Y=Domain(0, 0.3), Z=Domain(0, 0.3)}, {Plane=PlaneXY(0.5516, -0.15, -0.1500000003), X=Domain(0, 0.3), Y=Domain(0, 0.3), Z=Domain(0, 0.3)}, {Plane=Plane(origin=(0.9024, 0.15, -0.1500000003), x=(1, 0, 0), y=(0, -1, 0)), X=Domain(0, 0.3), Y=Domain(0, 0.3), Z=Domain(-0.3, 0)}, {Plane=Plane(origin=(0.9024, 0.5008, -0.1500000001), x=(1, 0, 0), y=(0, -1, 0)), X=Domain(0, 0.3), Y=Domain(0, 0.3), Z=Domain(-0.3, 0)}, {Plane=PlaneXY(0.9024, 0.5516, -0.15), X=Domain(0, 0.3), Y=Domain(0, 0.3), Z=Domain(0, 0.3)}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])  # disabled

panel_3 = Panel("Goal07")  # disabled
# Goal 07
box_3 = Box([{Plane=PlaneXY(-0.15, -0.15, -0.15), X=Domain(0, 0.3), Y=Domain(0, 0.3), Z=Domain(0, 0.3)}, {Plane=Plane(origin=(-0.15, 0.5008, -0.1500000001), x=(1, 0, 0), y=(0, -1, 0)), X=Domain(0, 0.3), Y=Domain(0, 0.3), Z=Domain(-0.3, 0)}, {Plane=Plane(origin=(0.2008, 0.15, -0.15), x=(1, 0, 0), y=(0, -1, 0)), X=Domain(0, 0.3), Y=Domain(0, 0.3), Z=Domain(-0.3, 0)}, {Plane=PlaneXY(0.2008, 0.2008, -0.1500000001), X=Domain(0, 0.3), Y=Domain(0, 0.3), Z=Domain(0, 0.3)}, {Plane=Plane(origin=(0.5516, 0.15, -0.15), x=(1, 0, 0), y=(0, -1, 0)), X=Domain(0, 0.3), Y=Domain(0, 0.3), Z=Domain(-0.3, 0)}, {Plane=Plane(origin=(0.9024, 0.15, -0.15), x=(1, 0, 0), y=(0, -1, 0)), X=Domain(0, 0.3), Y=Domain(0, 0.3), Z=Domain(-0.3, 0)}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])  # disabled

list_item = ListItem(List=box_3, Index=number_slider, Wrap=True)  # disabled

# ----
# 1. Load Robot From ROS
ros_connect = BooleanToggle(True)
robot_load = BooleanToggle(True)
compas_fab_ros_connect = COMPASFABROSConnect(connect=ros_connect)  # -> ros_client, is_connected; inputs port: Int32, connect: Boolean
#   port ip: The ip address ROS. Defaults to 127.0.0.1.
#   port port: The port of ROS. Defaults to 9090.
#   port connect: If True, connects to ROS. If False, disconnects from ROS. Defaults to False.
#   port ros_client: The ROS client.
#   port is_connected: True if connection established.
# ---------- compas_fab_ros_connect: Python ----------
"""
Connect or disconnect to ROS.

COMPAS FAB v1.0.2
"""

from ghpythonlib.componentbase import executingcomponent as component
from scriptcontext import sticky as st

from compas_fab.backends import RosClient
from compas_fab.ghpython.components import create_id


class ROSConnect(component):
    def RunScript(self, ip, port, connect):
        ros_client = None

        ip = ip or "127.0.0.1"
        port = port or 9090

        key = create_id(self, "ros_client")
        ros_client = st.get(key, None)

        if ros_client:
            st[key].close()
        if connect:
            st[key] = RosClient(ip, port)
            st[key].run(5)

        ros_client = st.get(key, None)
        is_connected = ros_client.is_connected if ros_client else False
        return (ros_client, is_connected)
# ---------- end compas_fab_ros_connect ----------
compas_fab_ros_robot = COMPASFABROSRobot(ros_client=compas_fab_ros_connect.ros_client, load=robot_load)  # -> robot; inputs load: Boolean
#   port ros_client: The ROS client.
#   port load: If True, loads the robot from ROS. Defaults to False.
# ---------- compas_fab_ros_robot: Python ----------
"""
Load robot directly from ROS.

COMPAS FAB v1.0.2
"""

from compas.scene import SceneObject
from ghpythonlib.componentbase import executingcomponent as component
from scriptcontext import sticky as st

from compas_fab.ghpython.components import create_id


class ROSRobot(component):
    def RunScript(self, ros_client, load):
        key = create_id(self, "robot")

        if ros_client and ros_client.is_connected and load:
            # Load URDF from ROS
            st[key] = ros_client.load_robot(load_geometry=True, precision=12)
            st[key].scene_object = SceneObject(st[key].model)

        robot = st.get(key, None)
        if robot:  # client sometimes need to be restarted, without needing to reload geometry
            robot.client = ros_client
        return robot
# ---------- end compas_fab_ros_robot ----------
robot = Data(compas_fab_ros_robot)

# ----
# 2. Get Robot Zero Configuration
robot_2 = Data(compas_fab_ros_robot)
compas_fab_zero_config = COMPASFABZeroConfig(robot=robot_2)  # -> config
#   port group: If assigned, it will return the zero configuration for the given group, otherwise a full zero configuration.
#   port config: The zero configuration.
# ---------- compas_fab_zero_config: Python ----------
"""
Get a zero configuration for a robot.

COMPAS FAB v1.0.2
"""

from ghpythonlib.componentbase import executingcomponent as component


class ConfigZero(component):
    def RunScript(self, robot, group):
        if robot:
            return robot.zero_configuration(group)

        return None
# ---------- end compas_fab_zero_config ----------
zero_config = Data(compas_fab_zero_config)

base = Slider(216, range=-360..360)
shoulder = Slider(302, range=-360..360)
elbow = Slider(-135, range=-180..180)
wrist1 = Slider(319, range=-360..360)
wrist2 = Slider(75, range=-360..360)
wrist3 = Slider(-305, range=-360..360)
# 3. Define Custom Configuration
robot_3 = Data(compas_fab_ros_robot)
ghpython_script = GhPythonScript(robot=robot_3, base=base, shoulder=shoulder, elbow=elbow, wrist_1=wrist1, wrist_2=wrist2, wrist_3=wrist3)  # -> out, config; inputs base: Int32, shoulder: Int32, elbow: Int32, wrist_1: Int32, wrist_2: Int32, wrist_3: Int32
# ---------- ghpython_script: Python ----------
from compas_robots import Configuration
import math

base_rad = math.radians(base)
shoulder_rad = math.radians(shoulder)
elbow_rad = math.radians(elbow)
wrist_1_rad = math.radians(wrist_1)
wrist_2_rad = math.radians(wrist_2)
wrist_3_rad = math.radians(wrist_3)

joint_values = [base_rad, shoulder_rad, elbow_rad, wrist_1_rad, wrist_2_rad, wrist_3_rad]
joint_names = ['shoulder_pan_joint', 'shoulder_lift_joint', 'elbow_joint', 'wrist_1_joint', 'wrist_2_joint', 'wrist_3_joint']
joint_types = [0, 0, 0, 0, 0, 0]

config = Configuration(joint_values, joint_types, joint_names)
# ---------- end ghpython_script ----------
custom_config = Data(ghpython_script.config)

xy_plane = XYPlane(Origin=Point(0, 0, 0))
ghpython_script_2 = GhPythonScript()  # -> out, current_tool_plane, closest_target_plane, exit_safe_frame, closest_target_name, approach_pick_plane, pick_plane, approach_place_plane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
# ---------- ghpython_script_2: Python ----------
from compas.data import json_load
from compas_rhino.conversions import frame_to_rhino_plane
from compas_robots import Configuration
from compas.geometry import Frame

joint_names = ['shoulder_pan_joint', 'shoulder_lift_joint', 'elbow_joint', 'wrist_1_joint', 'wrist_2_joint', 'wrist_3_joint']
joint_types = [0, 0, 0, 0, 0, 0]

fp = r"C:\Users\jk6372\Desktop\00_princeton_projects\00_robotic_territories\00_git\compas_xr_robotic_territories\dev\performance_operations\robots\com_handlers\planning_frames_debug.json"
data = json_load(fp)
approach_pick_plane = frame_to_rhino_plane(data["approach_pick_frame"])
approach_place_plane = frame_to_rhino_plane(data["approach_place_frame"])
place_plane = frame_to_rhino_plane(data["place_frame"])
current_tool_plane = frame_to_rhino_plane(data["current_tool_frame"])
closest_target_plane = frame_to_rhino_plane(data["closest_target_frame"])
exit_safe_frame = frame_to_rhino_plane(data["exit_safe_frame"])
pick_plane = frame_to_rhino_plane(data["pick_frame"])
closest_target_name = data["colsest_target_name"]
current_config = data["current_config"]


completed_items_names = []
completed_items = []
incomplete_items = []
incomplete_items_names = []

for frame in data["completed_items_dict"].items():
    plane = frame_to_rhino_plane(frame[1])
    completed_items.append(plane)
    completed_items_names.append(frame[0])

for frame in data["incompleted_items_dict"].items():
    plane = frame_to_rhino_plane(frame[1])
    incomplete_items.append(plane)
    incomplete_items_names.append(frame[0])
# ---------- end ghpython_script_2 ----------
ghpython_script_3 = GhPythonScript()  # -> out, suggested_goal, suggested_target, suggested_target_frame, geometry_frames_before_tx, geometry_frames_names_before_tx, geometry_frames_names_after_tx, geometry_frames_after_tx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
# ---------- ghpython_script_3: Python ----------
from compas.data import json_load
from compas_rhino.conversions import frame_to_rhino_plane
from compas_robots import Configuration
from compas.geometry import Frame

joint_names = ['shoulder_pan_joint', 'shoulder_lift_joint', 'elbow_joint', 'wrist_1_joint', 'wrist_2_joint', 'wrist_3_joint']
joint_types = [0, 0, 0, 0, 0, 0]

fp = r"C:\Users\jk6372\Desktop\00_princeton_projects\00_robotic_territories\00_git\compas_xr_robotic_territories\dev\performance_operations\inference\inference_debug.json"
data = json_load(fp)
#approach_pick_plane = frame_to_rhino_plane(data["approach_pick_frame"])
#approach_place_plane = frame_to_rhino_plane(data["approach_place_frame"])
#place_plane = frame_to_rhino_plane(data["place_frame"])
#current_tool_plane = frame_to_rhino_plane(data["current_tool_frame"])
#closest_target_plane = frame_to_rhino_plane(data["closest_target_frame"])
#exit_safe_frame = frame_to_rhino_plane(data["exit_safe_frame"])
#pick_plane = frame_to_rhino_plane(data["pick_frame"])
#closest_target_name = data["colsest_target_name"]
#current_config = data["current_config"]
#
#
geometry_frames_names_before_tx = []
geometry_frames_before_tx = []

geometry_frames_names_after_tx = []
geometry_frames_after_tx = []


transformed_geometry_frames = []
transformed_geometry_frames_names = []

for frame in data["geometry_frames_input_before_tx"].items():
    plane = frame_to_rhino_plane(frame[1])
    geometry_frames_before_tx.append(plane)
    geometry_frames_names_before_tx.append(frame[0])


for frame in data["geometry_frames_input_after_tx"].items():
    plane = frame_to_rhino_plane(frame[1])
    geometry_frames_after_tx.append(plane)
    geometry_frames_names_after_tx.append(frame[0])

for frame in data["transformed_geometry_frames"].items():
    plane = frame_to_rhino_plane(frame[1])
    transformed_geometry_frames.append(plane)
    transformed_geometry_frames_names.append(frame[0])

suggested_goal = data["suggested_goal"]
suggested_target = data["suggested_target_name"]
suggested_target_frame = frame_to_rhino_plane(data["target_frame"])
suggested_target_frame_transformed = frame_to_rhino_plane(data["suggested_target_frame_transformed"])
completed_goal_indexes = data["completed_goal_indexes"]
# ---------- end ghpython_script_3 ----------
rotate = Rotate(Geometry=xy_plane, Angle=degrees("-90"), Plane=PlaneXY(0, 0, 0))  # -> Geometry, Transform
plane = Plane(ghpython_script_2.incomplete_items)
plane_2 = Plane(ghpython_script_2.completed_items)
list_item_2 = ListItem(List=plane_2, Index=0, Wrap=True)
orient = Orient(Geometry=cluster, Source=PlaneXY(0, 0, 0), Target=list_item_2)  # -> Geometry, Transform

list_item_3 = ListItem(List=plane_2, Index=0, Wrap=True)  # disabled
orient_2 = Orient(Geometry=plane, Source=list_item_3, Target=PlaneXY(0, 0, 0))  # -> Geometry, Transform; disabled

plane_3 = Plane(ghpython_script_2.exit_safe_frame)
plane_4 = Plane(ghpython_script_2.exit_safe_frame)
plane_5 = Plane(ghpython_script_2.approach_place_plane)
plane_6 = Plane(ghpython_script_2.current_tool_plane)
plane_7 = Plane(ghpython_script_2.closest_target_plane)
plane_8 = Plane(ghpython_script_2.pick_plane)
plane_9 = Plane(ghpython_script_2.place_plane)
panel_4 = Panel(ghpython_script_2.closest_target_name)

# ----
# Realtime Mimic Pick
number_slider_2 = Slider(10, range=0..10)
# Realtime Mimic Place
ghpython_script_4 = GhPythonScript()  # -> out, requested_robot, geometry_frame, start_config, trajectory_points
# ---------- ghpython_script_4: Python ----------
from compas.data import json_load
from compas_rhino.conversions import frame_to_rhino_plane

fp = r"C:\Users\jk6372\Desktop\00_princeton_projects\00_robotic_territories\00_git\compas_xr_robotic_territories\dev\performance_operations\robots\com_handlers\pick_and_place_init_test\place_request_debug.json"

data = json_load(fp)
requested_robot_frame = data["requested_robot_frame"]
geometry_frame = data["geometry_frame"]
start_config = data["start_config"]
place_ik = data["place_ik_config"]
trajectory = data["trajectories"]
print type(trajectory[0])

requested_robot = frame_to_rhino_plane(requested_robot_frame)
geometry_frame = frame_to_rhino_plane(geometry_frame)
trajectory_points = trajectory[0].points
# ---------- end ghpython_script_4 ----------
list_item_4 = ListItem(List=ghpython_script_4.trajectory_points, Index=number_slider_2, Wrap=True)

ghpython_script_5 = GhPythonScript()  # -> out, requested_robot, geometry_frame, start_config, trajectory_points
# ---------- ghpython_script_5: Python ----------
from compas.data import json_load
from compas_rhino.conversions import frame_to_rhino_plane

fp = r"C:\Users\jk6372\Desktop\00_princeton_projects\00_robotic_territories\00_git\compas_xr_robotic_territories\dev\performance_operations\robots\com_handlers\pick_and_place_init_test\pick_request_debug_2.json"

data = json_load(fp)
requested_robot_frame = data["requested_robot_frame"]
geometry_frame = data["geometry_frame"]
start_config = data["start_config"]
place_ik = data["pick_ik_configs"]
trajectory = data["trajectories"]
print type(trajectory[0])

requested_robot = frame_to_rhino_plane(requested_robot_frame)
geometry_frame = frame_to_rhino_plane(geometry_frame)

trajectory_points = []
for traj in trajectory:
    trajectory_points.extend(traj.points)
# ---------- end ghpython_script_5 ----------
list_item_5 = ListItem(List=ghpython_script_5.trajectory_points, Index=Slider(0, range=0..30), Wrap=True)

plane_10 = Plane(ghpython_script_3.suggested_target_frame_transformed)
plane_11 = Plane(ghpython_script_3.suggested_target_frame)
plane_12 = Plane(ghpython_script_3.transformed_geometry_frames)

list_item_6 = ListItem(List=plane_12, Index=0, Wrap=True)
orient_3 = Orient(Geometry=plane_12, Source=xy_plane, Target=rotate.Geometry)  # -> Geometry, Transform

plane_13 = Plane(ghpython_script_3.geometry_frames_before_tx)
text_tag_3d = TextTag3D(Location=plane_2, Text=ghpython_script_2.completed_items_names, Size=0.05, Justification=7)
text_tag_3d_2 = TextTag3D(Location=plane, Text=ghpython_script_2.incomplete_items_names, Size=0.05, Justification=7)

value_list = ValueList({"0. zero config": 0, "1. custom config": 1}, selected="1. custom config")
robot_4 = Data(robot)

zero_config_2 = Data(zero_config)
custom_config_2 = Data(custom_config)
plane_14 = Plane(ghpython_script_3.geometry_frames_before_tx)
list_item_7 = ListItem(List=plane_14, Index=0, Wrap=True)  # -> Item, Item1, Item2, Item3
text_tag_3d_3 = TextTag3D(Location=plane_13, Text=ghpython_script_3.geometry_frames_names_before_tx, Size=0.05, Justification=7)
text_tag_3d_4 = TextTag3D(Location=plane_12, Text=ghpython_script_3.transformed_geometry_frames_names, Size=0.05, Justification=7)
plane_15 = Plane(ghpython_script_3.geometry_frames_after_tx)
text_tag_3d_5 = TextTag3D(Location=plane_14, Text=ghpython_script_3.geometry_frames_names_before_tx, Size=0.05, Justification=7)
panel_5 = Panel(ghpython_script_3.suggested_target)
panel_6 = Panel(ghpython_script_3.suggested_goal)
text_tag_3d_6 = TextTag3D(Location=plane_15, Text=ghpython_script_3.geometry_frames_names_after_tx, Size=0.05, Justification=7)
stream_filter = StreamFilter(Gate=value_list, Stream0=zero_config_2, Stream1=custom_config_2)
list_item_8 = ListItem(List=stream_filter, Index=0, Wrap=True)
ghpython_script_6 = GhPythonScript()  # -> out, robot_frames, robot_planes
# ---------- ghpython_script_6: Python ----------
from compas.data import json_load
from compas_rhino.conversions import frame_to_rhino_plane

fp = r"C:\Users\jk6372\Desktop\00_princeton_projects\00_robotic_territories\00_git\compas_xr_robotic_territories\dev\performance_operations\robots\com_handlers\ik_configurations_ros.json"

data = json_load(fp)
robot_frames = data["robot_frames"]
print (len(robot_frames))


robot_planes = [frame_to_rhino_plane(f) for f in robot_frames]
# ---------- end ghpython_script_6 ----------

# ----
# 4. Robot Visualization
compas_fab_robot_visualize = COMPASFABRobotVisualize(robot=robot_4, configuration=list_item_5, show_base_frame=True)  # -> visual, collision, collision_meshes, attached_meshes, frames, base_frame, ee_frame; inputs show_visual: Boolean, show_collision: Boolean, show_frames: Boolean, show_base_frame: Boolean, show_end_effector_frame: Boolean, show_cm: Boolean, show_acm: Boolean
#   port group: The planning group used for end-effector and base visualization.
#   port configuration: The robot's full configuration.
#   port show_visual: Whether or not to show the robot's visual meshes.
#   port show_collision: Whether or not to show the robot's collision meshes.
#   port show_frames: Whether or not to show the robot's joint frames.
#   port show_base_frame: Whether or not to show the robot's base frame.
#   port show_end_effector_frame: Whether or not to show the robot's end-effector frame.
#   port show_cm: Whether or not to show the collision meshes (if any).
#   port show_acm: Whether or not to show the attached collision meshes (if any).
#   port visual: Rhino meshes of the robot's visual geometry (if any).
#   port collision: Rhino meshes of the robot's collision geometry (if any).
#   port collision_meshes: Rhino meshes of the scene's collision meshes (if any).
#   port attached_meshes: Rhino meshes of the scene's attached collision meshes (if any).
#   port frames: The robot's joint frames as Rhino planes (if any).
#   port base_frame: The robot's base frame as a Rhino plane (if any).
#   port ee_frame: The robot's end-effector frame as a Rhino plane (if any).
# ---------- compas_fab_robot_visualize: Python ----------
"""
Visualizes the robot.

COMPAS FAB v1.0.2
"""

import time

from compas.geometry import Frame
from compas.geometry import Transformation
from compas.scene import SceneObject
from compas_ghpython import create_id
from compas_rhino.conversions import frame_to_rhino_plane
from ghpythonlib.componentbase import executingcomponent as component
from scriptcontext import sticky as st

from compas_fab.backends import BackendFeatureNotSupportedError
from compas_fab.robots import PlanningScene


class RobotVisualize(component):
    def RunScript(
        self,
        robot,
        group,
        configuration,
        show_visual,
        show_collision,
        show_frames,
        show_base_frame,
        show_end_effector_frame,
        show_cm,
        show_acm,
    ):
        visual = None
        collision = None
        collision_meshes = None
        attached_meshes = None
        frames = None
        base_frame = None
        ee_frame = None

        if robot:
            show_visual = True if show_visual is None else show_visual
            show_cm = True if show_cm is None else show_cm
            show_acm = True if show_acm is None else show_acm
            configuration = configuration or robot.zero_configuration()

            robot.update(configuration, visual=show_visual, collision=show_collision)
            compas_frames = robot.transformed_frames(configuration, group)

            if show_visual:
                visual = robot.scene_object.draw_visual()

            if show_collision:
                collision = robot.scene_object.draw_collision()

            if show_base_frame:
                base_compas_frame = compas_frames[0]
                base_frame = frame_to_rhino_plane(base_compas_frame)

            if show_end_effector_frame:
                options = dict(solver="model")
                if robot.attached_tool:
                    options["link"] = robot.attached_tool.connected_to

                ee_compas_frame = robot.forward_kinematics(configuration, group, options=options)
                ee_frame = frame_to_rhino_plane(ee_compas_frame)

            if show_frames:
                frames = []
                for compas_frame in compas_frames[1:]:
                    frame = frame_to_rhino_plane(compas_frame)
                    frames.append(frame)

            cached_scene_key = create_id(self, "cached_scene")

            if show_cm or show_acm:
                cached_scene = st.get(cached_scene_key)
                if not cached_scene:
                    cached_scene = {"time": 0}

                # expire cache if the component has not been executed in the last 2 seconds
                # this allows to slide through a list of configurations
                # without triggering refreshes of the scene in the middle of it
                if time.time() - cached_scene["time"] > 2:
                    update_scene = True
                else:
                    update_scene = False

                if update_scene:
                    scene = PlanningScene(robot)
                    try:
                        scene = robot.client.get_planning_scene()
                    except BackendFeatureNotSupportedError:
                        print(
                            "The selected backend does not support collision meshes. If you need collision mesh support, use a different backend."
                        )
                        scene = None
                        show_cm = False
                        show_acm = False

                if update_scene and show_cm:
                    collision_meshes = []

                    for co in scene.world.collision_objects:
                        header = co.header
                        frame_id = header.frame_id
                        cms = co.to_collision_meshes()

                        for cm in cms:
                            if cm.frame != Frame.worldXY():
                                t = Transformation.from_frame(cm.frame)
                                mesh = cm.mesh.transformed(t)
                            else:
                                mesh = cm.mesh

                            collision_meshes.extend(SceneObject(mesh).draw())

                        cached_scene["cm"] = collision_meshes

                collision_meshes = cached_scene.get("cm", [])

                if update_scene and show_acm:
                    attached_meshes = []

                    for aco in scene.robot_state.attached_collision_objects:
                        for acm in aco.to_attached_collision_meshes():
                            frame_id = aco.object["header"]["frame_id"]
                            frame = robot.forward_kinematics(configuration, options=dict(link=frame_id))
                            t = Transformation.from_frame(frame)

                            # Local CM frame
                            if acm.collision_mesh.frame and acm.collision_mesh.frame != Frame.worldXY():
                                t = t * Transformation.from_frame(acm.collision_mesh.frame)

                            mesh = acm.collision_mesh.mesh.transformed(t)

                            attached_meshes.extend(SceneObject(mesh).draw())

                    cached_scene["acm"] = attached_meshes

                attached_meshes = cached_scene.get("acm", [])

                cached_scene["time"] = time.time()
                st[cached_scene_key] = cached_scene

        return (
            visual,
            collision,
            collision_meshes,
            attached_meshes,
            frames,
            base_frame,
            ee_frame,
        )
# ---------- end compas_fab_robot_visualize ----------
mesh = Mesh(compas_fab_robot_visualize.visual)

plane_16 = Plane(ghpython_script_6.robot_planes)

# ==== cluster Cluster
geometry = ClusterInput()
rotate = Rotate(Geometry=geometry, Angle=1.570796327, Plane=PlaneXY(0, 0, 0))  # -> Geometry, Transform
area = Area(Geometry=rotate.Geometry)  # -> Area, Centroid
xy_plane = XYPlane(Origin=area.Centroid)
center_box = CenterBox(Base=xy_plane, X="0.15", Y="0.15", Z="0.15")
box = ClusterOutput(center_box)
